# Grasshopper definition BoxSphereMakerVariableghx.ghx (Grasshopper 0.9.61)

I = Item()
null = NullItem(Item=I)  # -> NullFlags, InvalidFlags, Description
xy = XYPlane(Origin=Point(0, 0, 0))
filter = StreamFilter(Gate=null.NullFlags, Stream0=I, Stream1=Slider(8, range=0..10))
vec = VectorXYZ(XComponent=filter, YComponent=filter, ZComponent=filter)  # -> Vector, Length
box = CenterBox(Base=xy, X=filter, Y=filter, Z=filter)
move = Move(Geometry=box, Motion=vec.Vector)  # -> Geometry, Transform
sunion = SolidUnion(Breps=[box, move.Geometry])
R = Result(sunion)
