# Grasshopper definition HexagridOnSrf.ghx (Grasshopper 0.9.64)

slider = Slider(5, range=1..5)
slider_2 = Slider(5, range=1..5)
ex = VariableEx()
S = VariableS()
ey = VariableEy()
srf = Surface(<surface referenced from the Rhino model>)
c_hexagridonsrf = CSharpScript(S=S, Ex=ex, Ey=ey)  # -> out, C, P; inputs S: Surface, Ex: Int32, Ey: Int32
# ---------- c_hexagridonsrf: C# ----------
    //Based on Rhinoscript code written and copyrighted by Ted Ngai Feb 2007
    //Ported to GH by Evert Amador
    //version 2010 Oct 30

    //We begin by performing a series of checks
    if(S == null) return;
    if(Ex == 0) return;
    if (Ey == 0) return;



    //We get the surface domain

    Rhino.Geometry.Interval DomainU = S.Domain(0);
    Rhino.Geometry.Interval DomainV = S.Domain(1);

    double stp = Math.PI / 3;
    int Hex_uCount = Ex;
    int Hex_vCount = Ey;



    double uLength = Hex_uCount * (3 * Math.Cos(stp)) + Math.Cos(stp);
    double vLength = Hex_vCount * (2 * Math.Sin(stp)) + Math.Sin(stp);
    double dUspacing = (DomainU.T1 - DomainU.T0) / (uLength);
    double dVspacing = (DomainV.T1 - DomainV.T0) / (vLength);

    //Instantiate a list of Polylines to output as C
    DataTree<Polyline> myC = new DataTree<Polyline>();
    DataTree<Point3d> myPt = new DataTree<Point3d>();

    for(int v = 0; v <= Hex_vCount - 1; v++)
    {
      GH_Path p = new GH_Path(v);

      for(int u = 0; u <= Hex_uCount - 1; u++)
      {
        //GH_Path q = new GH_Path(u);

        myC.Add(DrawHex(S, u, v, stp, dUspacing, dVspacing), p);
        myPt.Add(CentrePt(S, u, v, stp, dUspacing, dVspacing), p);

      }
    }

    myC.RenumberPaths("0, 0,{i}");
    myPt.RenumberPaths("0, 0, {i}");

    C = myC;
    P = myPt;
# ---------- c_hexagridonsrf: C# additional code ----------
  Polyline DrawHex (Surface S, int u, int v, double stp, double dUspacing, double dVspacing)
  {

    double x;
    double y;
    double dx;
    double dy;

    Point3dList Pts = new Point3dList(6);
    Point3d Pt = new Point3d();
    Polyline Pol = new Polyline();

    for(double t = 0; t <= 2 * Math.PI; t = t + stp){

      x = u + u * Math.Cos(stp) + 2 * Math.Cos(stp) + Math.Cos(t);
      y = (2 * v * Math.Sin(stp)) + (Math.Sin(stp) * (Math.Pow((0), (u % 2)))) + Math.Sin(stp) + Math.Sin(t);

      dx = x * dUspacing;
      dy = y * dVspacing;

      Pt = S.PointAt(dx, dy);
      Pts.Add(Pt);

    }
    Pol = new Polyline(Pts);
    return Pol;
  }


  Point3d CentrePt (Surface S, int u, int v, double stp, double dUspacing, double dVspacing)
  {

    double x1;
    double y1;

    double px1;
    double py1;

    Point3d Pt = new Point3d();
    
    x1 = u + u * Math.Cos(stp) + 2 * Math.Cos(stp);
    y1 = (2 * v * Math.Sin(stp)) + (Math.Sin(stp) * (Math.Pow((0), (u % 2)))) + Math.Sin(stp);

    px1 = x1 * dUspacing;
    py1 = y1 * dVspacing;

    Pt = S.PointAt(px1, py1);
    return Pt;
  }
# ---------- end c_hexagridonsrf ----------
out = Output(c_hexagridonsrf.out)
P = ResultP(c_hexagridonsrf.P)
C = ResultC(c_hexagridonsrf.C)
panel = Panel(c_hexagridonsrf.out)
viewer = ParamViewer(c_hexagridonsrf.C)
