# Grasshopper definition NestedSpheres.ghx (Grasshopper 0.9.64)
# plug-ins: Python Interpreter

radinit = Number()
panel = Panel("""temp = [x * 2, x * 5, x * 7, x* 10]
a = map(lambda y: y/10, temp)""")
radinit_2 = Number(radinit)
python = PythonScript(Code=panel, X=radinit_2)  # -> Out, A
clean = CleanTree(Tree=python.A, CleanInvalid=True, CleanEmpty=False)
sph = Sphere(Base=PlaneXY(0, 0, 0), Radius=clean)
geooutput = Geometry(sph)
geooutput_2 = Geometry(geooutput)
resultinggeo = Geometry()
resultinggeo_2 = Geometry(resultinggeo)
