# Grasshopper definition RandomSphereMaker.ghx (Grasshopper 0.9.64)

pairnum = Number()
number_slider = Slider(12, range=0..100)
pairnum_2 = Number(pairnum)
multiplication = Multiplication(A=pairnum_2, B=2)
series = Series(Start=0, Step=1, Count=multiplication)
jitter = Jitter(List=series, Jitter=1, Seed=2)  # -> Values, Indices
dispatch = Dispatch(List=jitter.Values, DispatchPattern=[True, False])  # -> ListA, ListB
short = ShortestList(ListA=dispatch.ListA, ListB=dispatch.ListB, TrimMode=2)  # -> ListA, ListB
sph = Sphere(Base=PlaneXY(0, 0, 0), Radius=1)
vec = VectorXYZ(XComponent=short.ListA, YComponent=short.ListB, ZComponent=0)  # -> Vector, Length
move = Move(Geometry=sph, Motion=vec.Vector)  # -> Geometry, Transform
resultinggeo = Geometry(move.Geometry)
resultinggeo_2 = Geometry(resultinggeo)
