# Grasshopper definition TypedParamTest.ghx (Grasshopper 0.9.64)

brep = Brep()
vec = Vector()
num = Number()
vec_2 = Vector(vec)
num_2 = Number(num)
brep_2 = Brep(brep)
scale = Scale(Geometry=brep_2, Center=Point(0, 0, 0), Factor=num_2)  # -> Geometry, Transform
move = Move(Geometry=scale.Geometry, Motion=vec_2)  # -> Geometry, Transform
num_3 = Number(num_2)
geo = Geometry(move.Geometry)
num_4 = Number(num_3)
geo_2 = Geometry(geo)
