# Grasshopper definition WormholeMaker.ghx (Grasshopper 0.9.64)

pt = Point()
num = Number()
pt_2 = Point()
pt_3 = Point(pt_2)
pt_4 = Point(pt)
number_slider = Slider(3, range=0..10)
num_2 = Number(num)
dist = Distance(PointA=pt_3, PointB=pt_4)
number_slider_2 = Slider(4, range=0..10)
division = Division(A=dist, B=num_2)
sph = Sphere(Base=pt_4, Radius=division)
sph_2 = Sphere(Base=pt_3, Radius=division)
vec2pt = Vector2Pt(PointA=pt_3, PointB=pt_4, Unitize=False)  # -> Vector, Length
division_2 = Division(A=division, B=num_2)
pl = PlaneNormal(Origin=pt_3, ZAxis=vec2pt.Vector)
pl_2 = PlaneNormal(Origin=pt_4, ZAxis=vec2pt.Vector)
division_3 = Division(A=dist, B="2")
cir = Circle(Plane=pl, Radius=division)
cir_2 = Circle(Plane=pl_2, Radius=division)
cir_3 = Circle(Plane=pl, Radius=division_2)
amp = Amplitude(Vector=cir_3, Amplitude=division_3)
move = Move(Geometry=cir_3, Motion=amp)  # -> Geometry, Transform
pipe = Pipe(Curve=cir_3, Radius=division_2, Caps=0)
geo = Geometry([cir, move.Geometry, cir_2])
geo_2 = Geometry([sph_2, sph])
loft = Loft(Curves=geo, Options={Adjust=False, Closed=False, LoftEnds=0, LoftSimp=0, LoftType=0, Rebuild=10, Refit=0.01})
cap = CapHoles(Brep=loft)
munion = MeshUnion()
geo_3 = Geometry(flatten([cap, geo_2, pipe]))
geo_4 = Geometry(geo_3)
