# Grasshopper definition hairworm_basic_example.ghx (Grasshopper 0.9.65)
# plug-ins: Hairworm

panel = Panel("https://github.com/provolot/GrasshopperExchange/raw/master/Hairworm/_example_files/geometrylisttest.ghx")
panel_2 = Panel("""1
2
3
4""")
geo = Geometry([<point referenced from the Rhino model> x11])
# https://github.com/provolot/GrasshopperExchange/raw/master/Hairworm/_example_files/SphereMaker.ghcluster
# https://raw.github.com/provolot/GrasshopperExchange/master/Hairworm/_example_files/BoxSphereMakerVariableghx.ghx
panel_3 = Panel("https://github.com/provolot/GrasshopperExchange/raw/master/Hairworm/_example_files/TypedParamTest.ghx")
# https://github.com/provolot/GrasshopperExchange/raw/master/Hairworm/_example_files/HexagridOnSrf.ghx
# https://github.com/provolot/GrasshopperExchange/raw/master/Hairworm/_example_files/NestedSpheres.ghx
# https://github.com/provolot/GrasshopperExchange/raw/master/Hairworm/_example_files\RandomSphereMaker.ghx
panel_4 = Panel("https://github.com/provolot/GrasshopperExchange/raw/master/Hairworm/_example_files\WormholeMaker.ghx")
hairworm_geometrylisttest = HairwormGeometrylisttest(ClusterURL=panel, List=geo)  # -> Debug, Geometry, Circle
number_slider = Slider(33, range=0..100)
panel_5 = Panel("3")
number_slider_2 = Slider(7, range=0..10)
hairworm_boxspheremakervariableghx = HairwormBoxSphereMakerVariableghx(ClusterURL="stddev")
number_slider_3 = Slider(5, range=0..10)
number_slider_4 = Slider(10, range=0..10)
panel_11 = Panel("""1
1
1
1
2""")
panel_12 = Panel("""3
4
5
222
5
4""")
geo_2 = Geometry()
num = Number(panel_11)
hairworm_boxspheremakervariableghx_2 = HairwormBoxSphereMakerVariableghx(ClusterURL="stddev")
num_2 = Number(panel_12)
hairworm_typedparamtest = HairwormTypedParamTest(ClusterURL=panel_3)  # -> Debug, Geometry, Number
geo_3 = Geometry()
hairworm_stddev = HairwormStddev(ClusterURL="stddev", Number=num)  # -> Debug, Number
entwine = Entwine(Branch00=num, Branch01=num_2)  # -> simplify(flatten(Result))
geo_4 = Geometry(flatten(geo_3))
jitter = Jitter(List=geo_4, Jitter=1, Seed=2)  # -> Values, Indices
panel_13 = Panel(hairworm_stddev.Number)
dispatch = Dispatch(List=jitter.Values, DispatchPattern=[True, False])  # -> ListA, ListB
short = ShortestList(ListA=dispatch.ListA, ListB=dispatch.ListB, TrimMode=2)  # -> ListA, ListB
hairworm_wormholemaker = HairwormWormholeMaker(ClusterURL=panel_4, Point=short.ListA, Point_2=short.ListB, Number=Slider(9, range=0..10))  # -> Debug, Geometry
colour = ColourPicker(PickedColour=RGB(242, 239, 31))
geo_5 = Geometry(hairworm_wormholemaker.Geometry)
preview = CustomPreview(Geometry=geo_5, Shader=colour)
