# Grasshopper definition octopus_test_v0.ghx (Grasshopper 0.9.65)
# plug-ins: Octopus

number_slider = Slider(34, range=0..100)
geo = Geometry(<curve referenced from the Rhino model>)
number_slider_2 = Slider(18, range=0..100)
Z = UnitZ(Factor=number_slider)
geo_2 = Geometry(geo)
Z_2 = UnitZ(Factor=number_slider_2)
move = Move(Geometry=geo, Motion=Z)  # -> Geometry, Transform
area = Area(Geometry=move.Geometry)  # -> Area, Centroid
number_slider_3 = Slider(1.4, range=0..4)
move_2 = Move(Geometry=geo_2, Motion=Z_2)  # -> Geometry, Transform
scale = Scale(Geometry=move.Geometry, Center=area.Centroid, Factor=Slider(0.5, range=0..1))  # -> Geometry, Transform
area_2 = Area(Geometry=move_2.Geometry)  # -> Area, Centroid
xy = XYPlane(Origin=area.Centroid)
scale_2 = Scale(Geometry=move_2.Geometry, Center=area_2.Centroid, Factor=number_slider_3)  # -> Geometry, Transform
rad = Radians(Degrees=Slider(23, range=0..360))
rotate = Rotate(Geometry=scale.Geometry, Angle=rad, Plane=xy)  # -> Geometry, Transform
multiplication = Multiplication(A=number_slider_2, B=2)
Z_3 = UnitZ(Factor=multiplication)
multiplication_2 = Multiplication(A=number_slider)
Z_4 = UnitZ(Factor=multiplication_2)
move_3 = Move(Geometry=geo, Motion=Z_3)  # -> Geometry, Transform
geo_3 = Geometry()
move_4 = Move(Geometry=geo, Motion=Z_4)  # -> Geometry, Transform
merge = Merge(Data1=geo_2, Data2=scale_2.Geometry, Data3=move_3.Geometry)
merge_2 = Merge(Data1=geo, Data2=rotate.Geometry, Data3=move_4.Geometry)
loft_opt = LoftOptions(Closed=False, Adjust=True, Rebuild=0, Refit=0, Type=0)
loft = Loft(Curves=merge, Options=loft_opt)
loft_2 = Loft(Curves=merge_2, Options=loft_opt)
cap = CapHoles(Brep=loft)
octopus = Octopus(Phenotype=cap, OctopusData_gene=number_slider_3, OctopusData_obj=[num, num_2])
geo_4 = Geometry(cap)
cap_2 = CapHoles(Brep=loft_2)
volume = Volume(Geometry=cap)  # -> Volume, Centroid
debrep = DeconstructBrep(Brep=loft_2)  # -> Faces, Edges, Vertices
area_3 = Area(Geometry=cap)  # -> Area, Centroid
area_4 = Area(Geometry=debrep.Faces)  # -> flatten(Area), Centroid
Z_5 = UnitZ(Factor=1)
num = Number(volume.Volume)
num_2 = Number(area_3.Area)
panel = Panel("stddev")
num_3 = Number(flatten(area_4.Area))
contour = Contour(Shape=cap_2, Point=area.Centroid, Direction=Z_5, Distance=Slider(5, range=0..10))
volume_2 = Volume(Geometry=cap_2)  # -> Volume, Centroid
area_5 = Area(Geometry=cap_2)  # -> flatten(Area), Centroid
avr = Average(Input=num_3)
num_4 = Number(volume_2.Volume)
area_6 = Area(Geometry=contour)  # -> flatten(Area), Centroid
num_5 = Number(area_5.Area)
subtraction = Subtraction(A=avr, B=num_3)
ma = MassAddition(Input=area_6.Area)  # -> Result, PartialResults
sqr = Square(Value=subtraction)
panel_2 = Panel(ma.Result)
panel_3 = Panel(volume_2.Volume)
panel_4 = Panel(area_5.Area)
avr_2 = Average(Input=sqr)
sqrt = SquareRoot(Value=avr_2)
num_6 = Number(sqrt)
panel_5 = Panel(sqrt)
item = ListItem(Index="-1", Wrap=True)
