# Grasshopper definition stddev.ghx (Grasshopper 0.9.65)

input = Number()
input_2 = Number(input)
avr = Average(Input=input_2)
subtraction = Subtraction(A=input_2, B=avr)
sqr = Square(Value=subtraction)
avr_2 = Average(Input=sqr)
sqrt = SquareRoot(Value=avr_2)
stddev = Number(sqrt)
stddev_2 = Number(stddev)
panel = Panel(stddev)
